# Dynamo graph GetParameterValue_ElementName.dyn (Dynamo 2.6.1.8786)

# note: AUTHOR: Dana De Filippi
# VERSION: 1.00
# DESCRIPTION:
# Allows for user to copy a parameter value name (as it itself is an element) to a user specified parameter that can be used in a view filter within a Revit View.
# CUSTOM PACKAGES:
# n/a

# group: SPECIFY CATEGORY OF ELEMENTS TO UPDATE NODE: Categories
specify_category_of_elements_to = Categories("OST_Walls")  # "SPECIFY CATEGORY OF ELEMENTS TO UPDATE"

# group: SPECIFY PARAMETER TO COPY VALUE TO NODE: String
specify_parameter_to_copy_value = StringInput("Comments")  # "SPECIFY PARAMETER TO COPY VALUE TO"; graph input

# group: SPECIFY PARAMETER TO READ NODE: String
specify_parameter_to_read = StringInput("Phase Created")

# group: GET ALL ELEMENTS, GET PARAMETER VALUE NAME
all_elements_of_category = ElementsOfCategory(Category=specify_category_of_elements_to)
getParameterValueByName = Element.GetParameterValueByName(element=all_elements_of_category, parameterName=specify_parameter_to_read)
name = Element.Name(element=getParameterValueByName)

# group: REPLACE NULLS
code_block = CodeBlock { "(none)"; }
isNull = Object.IsNull()  # unwired: obj
replaceByCondition = Replace(item=name, replaceWith=code_block, condition=isNull)

# group: UPDATE PARAMETER VALUE
setParameterByName = Element.SetParameterByName(element=all_elements_of_category, parameterName=specify_parameter_to_copy_value, value=replaceByCondition)

# group: ELEMENTS UPDATED NODE: Watch
elements_updated = Watch(setParameterByName)  # graph output
