# Dynamo graph Walls_InfillPhaseCreated.dyn (Dynamo 2.6.1.8786)
# packages: Clockwork for Dynamo 2.x 2.3.0

# note: AUTHOR: Dana De Filippi
# VERSION: 1.00
# DESCRIPTION:
# Allows for user to copy Phase Created data from a Wall to a parameter (user specified) of its infill Wall elements.
# CUSTOM PACKAGES:
# Clockwork v.2.3.0

# group: GET ALL WALLS
string = StringInput("Walls")
byName = Category.ByName(name=string)
all_elements_of_category = ElementsOfCategory(Category=byName)

# group: FILTER OUT CURTAIN WALLS / STOREFRONT
name = Element.Name(element=all_elements_of_category)
code_block = CodeBlock()
# ---------- code_block.designscript (2 lines) ----------
["Curtain Wall",
"Storefront"];
# ----------------------------------------
contains = String.Contains(str=name, searchFor=code_block, lacing=CrossProduct)

boolean = BoolSelector(true)
contains_2 = List.Contains(list=contains@@L2, item=boolean)

# group (continued): FILTER OUT CURTAIN WALLS / STOREFRONT
filterByBoolMask = List.FilterByBoolMask(list=all_elements_of_category, mask=contains_2)

# group: FILTER OUT WALLS WITHOUT DEPENDENTS
# note: Custom Node: Clockwork v.2.3.0
dependentElements = Custom[Element.DependentElements](element=filterByBoolMask.out)  # package Clockwork for Dynamo 2.x; Returns all elements that, from a logical point of view, are the children of this element.
isEmpty = List.IsEmpty(list=dependentElements@L2)
filterByBoolMask_2 = List.FilterByBoolMask(list=filterByBoolMask.out, mask=isEmpty)

# group: FILTER TO WALLS WITH WALLS AS DEPENDENTS
# note: Custom Node: Clockwork v.2.3.0
dependentElements_2 = Custom[Element.DependentElements](element=filterByBoolMask_2.out)
getCategory = Element.GetCategory(element=dependentElements_2@L2)
name_2 = Category.Name(category=getCategory)
string_2 = StringInput("Walls")
eq = name_2@L2 == string_2
boolean_2 = BoolSelector(true)
contains_3 = List.Contains(list=eq@@L2, item=boolean_2)

# group: DEPENDENTS OF WALL(S) WITH INFILL
filterByBoolMask_3 = List.FilterByBoolMask(list=filterByBoolMask_2.out, mask=contains_3)
# note: Custom Node: Clockwork v.2.3.0
dependentElements_3 = Custom[Element.DependentElements](element=filterByBoolMask_3.in)
getCategory_2 = Element.GetCategory(element=dependentElements_3@L2)
name_3 = Category.Name(category=getCategory_2)
string_3 = StringInput("Walls")
eq_2 = name_3@L2 == string_3
filterByBoolMask_4 = List.FilterByBoolMask(list=dependentElements_3, mask=eq_2)
watch = Watch(filterByBoolMask_4.in)

# group: GET PHASE INFORMATION OF WALL(S)
watch_2 = Watch(filterByBoolMask_3.in)
code_block_2 = CodeBlock { "Phase Created"; }
getParameterValueByName = Element.GetParameterValueByName(element=filterByBoolMask_3.in, parameterName=code_block_2)
name_4 = Element.Name(element=getParameterValueByName)

# group: PARAMETER TO UPDATE
string_4 = StringInput("Comments")

# group: SET VALUE(S)
setParameterByName = Element.SetParameterByName(element=filterByBoolMask_4.in, parameterName=string_4, value=name_4)
